# Grasshopper definition parametric_wall.gh (Grasshopper 1.0.8)

py3 = Python3Script(
    X_Dimension=Slider(22, range=0..100),
    Y_Dimension=Slider(43, range=0..100),
    Distance_X=Slider(1.22, range=0..2),
    Distance_Y=Slider(0.22, range=0..2),
    radius=Slider(8.5, range=0..30),
    angle=Slider(28.15, range=0..90))  # -> out, Breps; inputs X_Dimension: Int32, Y_Dimension: Int32, angle: Double
# ---------- py3: Python ----------
import ghpythonlib as gh
import Rhino.Geometry as rg
import math

attractor_point_x = ((X_Dimension - 1) * Distance_X) / 2.0
attractor_point_y = ((Y_Dimension - 1) * Distance_Y) / 2.0
attractor_point = rg.Point3d(attractor_point_x, 0, attractor_point_y)

def remap(value, source_min, source_max, target_min, target_max):
    normal_value = (value - source_min) / (source_max - source_min)

    mapped_value = target_min + (normal_value * (target_max - target_min))
    return mapped_value

breps = []
for i in range(Y_Dimension):
    for j in range(X_Dimension):
        shift = 0.5 if i % 2 != 0 else 0
        pt = rg.Point3d((Distance_X * j) + shift, 0, (Distance_Y *i))

        distance = pt.DistanceTo(attractor_point)
        if distance <= radius:
            rotation_remap = remap(distance, 0, radius, angle, 0)
        else:
            rotation_remap = 0
        
        angle_rad = math.radians(rotation_remap)

        plane = rg.Plane(pt, rg.Vector3d.ZAxis)
        dom_x = rg.Interval(-0.5, 0.5)
        dom_y = rg.Interval(-0.3, 0.3)
        rectangle = rg.Rectangle3d(plane, dom_x, dom_y)
        rotation_pt = rectangle.Corner(1)
        rotation_matrix = rg.Transform.Rotation(angle_rad, rg.Vector3d.ZAxis, rotation_pt)
        crv = rectangle.ToNurbsCurve()
        crv.Transform(rotation_matrix)
        extrusion = rg.Extrusion.Create(crv, 0.2, True)
        breps.append(extrusion)

Breps = breps
# ---------- end py3 ----------
swatch = ColourSwatch(SwatchColor=RGB(178, 202, 0))
preview = CustomPreview(Geometry=py3.Breps, Material=ColourSwatch(SwatchColor=RGB(255, 255, 255)))
