# Grasshopper definition absorbor points.gh (Grasshopper 1.0.8)

number_slider = Slider(52, range=0..100)
number_slider_2 = Slider(43, range=0..100)
number_slider_3 = Slider(25, range=0..100)
pt = ConstructPoint(XCoordinate=Slider(53.07, range=0..100), YCoordinate=Slider(60.392, range=0..100), ZCoordinate=0)
pt_2 = ConstructPoint(XCoordinate=Slider(2.121, range=0..10), YCoordinate=Slider(5.94, range=0..10), ZCoordinate=0)
pt_3 = ConstructPoint(XCoordinate=Slider(0, range=0..22), YCoordinate=Slider(0, range=0..22), ZCoordinate=0)
pt_4 = ConstructPoint(XCoordinate=Slider(20, range=0..20), YCoordinate=Slider(20, range=0..20), ZCoordinate=0)
blackholes = Python3Script(
    X_Dimension=number_slider_2,
    Y_Dimension=number_slider_2,
    Step=Slider(1.747, range=0..5),
    Absorbor_Point=pt,
    Emitter_Point=pt_2)  # -> out, a; inputs X_Dimension: Int32, Y_Dimension: Int32, Step: Double, Absorbor_Point: Point3d, Emitter_Point: Point3d
# ---------- blackholes: Python ----------
import Rhino.Geometry as rg



initial_pts = []

distances = []

lines = []



#Construct points grid

for i in range(Y_Dimension):

    for j in range(X_Dimension):

        pt = rg.Point3d(j * Step, i * Step, 0)

        initial_pts.append(pt)



        dist_1 = pt.DistanceTo(Absorbor_Point)

        dist_2 = pt.DistanceTo(Emitter_Point)

        distances.append(min(dist_1, dist_2))



min_boundary = min(distances)

max_boundary = max(distances)



def remap(value, min_source, max_source, min_target, max_target):

    normal_val = (value - min_source) / (max_source - min_source)



    mapped_val = (normal_val * (max_target - min_target))

    return mapped_val



for pt, dist in zip(initial_pts, distances):

    vec_a = Absorbor_Point - pt

    vec_b = pt - Emitter_Point



    vec_a.Unitize()

    vec_b.Unitize()



    final_vec = vec_a + vec_b



    final_vec.Unitize()

    remap_value = remap(dist, min_boundary, max_boundary, 2, 0.05)

    final_vec = final_vec * remap_value

    second_pt = pt + final_vec



    lines.append(rg.Line(pt, second_pt))



a = lines
# ---------- end blackholes ----------
blackholes_2 = Python3Script(
    X_Dimension=number_slider_3,
    Y_Dimension=number_slider_3,
    Distance=Slider(1.337, range=0..5),
    iterations=Slider(20, range=0..100),
    step_size=Slider(0.5, range=0..1),
    Absorbor_Point=pt_3,
    Emitter_Point=pt_4)  # -> out, a; inputs X_Dimension: Int32, Y_Dimension: Int32, Distance: Double, iterations: Int32, step_size: Double, Absorbor_Point: Point3d, Emitter_Point: Point3d
# ---------- blackholes_2: Python ----------
import Rhino.Geometry as rg


seed_pts = []
curves = []

for i in range(Y_Dimension):
    for j in range(X_Dimension):
        seed_pts.append(rg.Point3d(j * Distance, i * Distance, 0))

z_axis = rg.Vector3d(0, 0, 1)

for start_pt in seed_pts:
    current_pt = start_pt
    trail = [current_pt] 
    
    for _ in range(iterations):
        dist_att = current_pt.DistanceTo(Absorbor_Point)
        dist_rep = current_pt.DistanceTo(Emitter_Point)
        
        if dist_att < 0.5 or dist_rep < 0.5:
            break
            
        vec_att = Absorbor_Point - current_pt
        vec_rep = current_pt - Emitter_Point
        
        vec_att.Unitize()
        vec_rep.Unitize()
        
        swirl_att = rg.Vector3d.CrossProduct(vec_att, z_axis)
        swirl_rep = rg.Vector3d.CrossProduct(vec_rep, -z_axis) 
        
        force_att = (vec_att * 0.1) + (swirl_att * 0.9)
        force_rep = (vec_rep * 0.1) + (swirl_rep * 0.9)
        
        weight_att = 1.0 / (dist_att + 0.1)
        weight_rep = 1.0 / (dist_rep + 0.1)
        
        final_vec = (force_att * weight_att) + (force_rep * weight_rep)
        
        final_vec.Unitize()
        final_vec *= step_size
        
        next_pt = current_pt + final_vec
        next_pt.Z = 0  
        
        trail.append(next_pt)
        current_pt = next_pt
        
    if len(trail) > 3:
        crv = rg.Curve.CreateControlPointCurve(trail, 3)
        if crv:
            curves.append(crv)

a = curves
# ---------- end blackholes_2 ----------
panel = Panel("Blue")
pipe = Pipe(Curve=blackholes_2.a, Radius=Slider(0.05, range=0..0.1), Caps=0, FitRail=False)
preview = CustomPreview(Geometry=flatten(pipe), Material=ColourSwatch(SwatchColor=RGB(223, 238, 255)))
