# Grasshopper definition unnamed.gh (Grasshopper 1.0.8)

py3 = Python3Script(
    X_Dimension=Slider(32, range=0..100),
    Y_Dimension=Slider(27, range=0..100),
    Distance=Slider(0.15, range=0..2),
    Step=Slider(1, range=0..2))  # -> out, a; inputs X_Dimension: Int32, Y_Dimension: Int32, Distance: Double
# ---------- py3: Python ----------
import Rhino.Geometry as rg


warp_curves = [] 
weft_curves = [] 

for i in range(Y_Dimension):
    warp_pts = []
    for j in range(X_Dimension):
        base_pt = rg.Point3d(j * Step, i * Step, 0)
        
        if (i + j) % 2 == 0:
            z_shift = Distance
        else:
            z_shift = -Distance
            
        moved_pt = base_pt + rg.Vector3d(0, 0, z_shift)
        warp_pts.append(moved_pt)
        
    if len(warp_pts) > 1:
        crv = rg.Curve.CreateInterpolatedCurve(warp_pts, 3)
        warp_curves.append(crv)

for j in range(X_Dimension):
    weft_pts = []
    for i in range(Y_Dimension):
        base_pt = rg.Point3d(j * Step, i * Step, 0)
        
        if (i + j) % 2 == 0:
            z_shift = -Distance  
        else:
            z_shift = Distance   
            
     
        moved_pt = base_pt + rg.Vector3d(0, 0, z_shift)
        weft_pts.append(moved_pt)
        

    if len(weft_pts) > 1:
        crv = rg.Curve.CreateInterpolatedCurve(weft_pts, 3)
        weft_curves.append(crv)


a = warp_curves + weft_curves
# ---------- end py3 ----------
pipe = Pipe(Curve=py3.a, Radius="0.08", Caps=0, FitRail=False)
preview = CustomPreview(Geometry=flatten(pipe), Material="white")
