# Grasshopper definition unnamed.gh (Grasshopper 1.0.8)

py3 = Python3Script()  # -> out, a
# ---------- py3: Python ----------
import Rhino.Geometry as rg
import random
import math

def v_1(point):
    a, b, c = 0.5, 0, 0
    d, e, f = 0, 0.5, 0.5
    x, y = point.X, point.Y
    x_1 = a*x + b*y + c
    y_1 = d*x + e*y + f
    return(x_1, y_1)

def v_2(point):
    a, b, c = 0.5, 0, -0.5
    d, e, f = 0, 0.5, -0.5
    x, y = point.X, point.Y
    x_1 = a*x + b*y + c
    y_1 = d*x + e*y + f
    return(x_1, y_1)

def v_3(point):
    a, b, c = 0.5, 0, 0.5
    d, e, f = 0, 0.5, -0.5
    x, y = point.X, point.Y
    x_1 = a*x + b*y + c
    y_1 = d*x + e*y + f
    return(x_1, y_1)

def non_linear(x_1, y_1):
    w1 = 0.7
    w2 = 0.3
    r = (x_1**2) + (y_1**2)
    if r == 0:
        r = 0.0001
    x_final = (w1*math.sin(x_1)) + (w2*(x_1/r))
    y_final = (w1*math.sin(y_1)) + (w2*(y_1/r))
    return(rg.Point3d(x_final, y_final, 0))

point_list = []
point_list.append(rg.Point3d(0, 0, 0))
n = 0

while n < 20000:
    pt = point_list[-1]
    num = random.randint(1,3)
    if num == 1:
        x1, y1 = v_1(pt)
    elif num == 2:
        x1, y1 = v_2(pt)
    else:
        x1, y1 = v_3(pt)
    final_pt = non_linear(x1, y1)
    point_list.append(final_pt)
    n += 1


a = point_list
# ---------- end py3 ----------
py3_2 = Python3Script()  # -> out, a
# ---------- py3_2: Python ----------
import math
import random
import System.Drawing as Drawing
import Rhino.Geometry as rg

num_points = 1000
res = 500

# 1. ماتریس‌های افین متضاد برای ایجاد بال‌ها و ریزپره‌ها
transforms = [
    #  a,      b,     c,      d,      e,     f,    w
    [ 0.78, -0.42,  0.00,   0.42,  0.78,   0.00,  0.42],  # بازوی اصلی چرخان کهکشان
    [-0.48,  0.62,  0.05,  -0.62, -0.48,  -0.05,  0.33],  # بازوی فرعی متقابل
    [ 0.15,  0.25, -0.10,  -0.25,  0.15,   0.10,  0.15],  # رشته‌های غبار اطراف هسته
    [ 0.05, -0.05,  0.00,   0.05,  0.05,   0.00,  0.10]   # ابرسیاه‌چاله و هسته متراکم
]

# ۲. تابع غیرخطی اختصاصی کهکشان مارپیچی (Logarithmic Spiral + Swirl)
def apply_true_galactic_core(x, y):
    r2 = x*x + y*y + 1e-6
    r = math.sqrt(r2)
    theta = math.atan2(y, x)
    
    # ۱. انحنای مارپیچ لوگاریتمی بازوها
    spiral_angle = theta + 1.2 * math.log(r + 0.1)
    fx1 = r * math.cos(spiral_angle)
    fy1 = r * math.sin(spiral_angle)
    
    # ۲. کشش کروی و گردابی به سمت هسته مرکزی (Spherical Core Pull)
    fx2 = x / (r2 + 0.3)
    fy2 = y / (r2 + 0.3)
    
    # ترکیب متوازن: ۷۰٪ بازوهای چرخشی + ۳۰٪ تمرکز هسته‌ای
    x_out = 0.70 * fx1 + 0.30 * fx2
    y_out = 0.70 * fy1 + 0.30 * fy2
    
    return x_out, y_out

# ۳. سیستم آشوب با ۶۰۰ هزار نقطه برای ظرافت سحابی‌ها
pts_x, pts_y, color_list = [], [], []
x, y = 0.1, 0.1
c_idx = 0.5

num_pts = int(num_points) if 'num_points' in globals() else 600000
res_val = int(res) if 'res' in globals() else 420

for n in range(num_pts):
    r_val = random.random()
    cumulative = 0.0
    selected_t = transforms[0]
    t_num = 0
    
    for idx, t in enumerate(transforms):
        cumulative += t[6]
        if r_val <= cumulative:
            selected_t = t
            t_num = idx
            break
            
    a, b, c, d, e, f, w = selected_t
    nx = a*x + b*y + c
    ny = d*x + e*y + f
    
    x, y = apply_true_galactic_core(nx, ny)
    c_idx = c_idx * 0.85 + (t_num / float(len(transforms))) * 0.15
    
    if n > 500:
        pts_x.append(x)
        pts_y.append(y)
        color_list.append(c_idx)

# ۴. کادربندی دقیق و حذف نقاط پرت
pts_x_sorted = sorted(pts_x)
pts_y_sorted = sorted(pts_y)

cut = int(len(pts_x) * 0.008)
min_x, max_x = pts_x_sorted[cut], pts_x_sorted[-cut]
min_y, max_y = pts_y_sorted[cut], pts_y_sorted[-cut]

span_x = (max_x - min_x) if max_x != min_x else 1.0
span_y = (max_y - min_y) if max_y != min_y else 1.0

grid_density = {}
grid_color = {}

for px, py, c_val in zip(pts_x, pts_y, color_list):
    if min_x <= px <= max_x and min_y <= py <= max_y:
        gx = int((px - min_x) / span_x * (res_val - 1))
        gy = int((py - min_y) / span_y * (res_val - 1))
        
        key = (gx, gy)
        grid_density[key] = grid_density.get(key, 0) + 1
        grid_color[key] = grid_color.get(key, c_val) * 0.8 + c_val * 0.2

# ۵. رندر مش با پالت خاص کهکشانی و هسته افروخته
mesh = rg.Mesh()
max_d = max(grid_density.values()) if grid_density else 1

for j in range(res_val):
    for i in range(res_val):
        x_w = (i / float(res_val - 1)) * 20.0 - 10.0
        y_w = (j / float(res_val - 1)) * 20.0 - 10.0
        mesh.Vertices.Add(x_w, y_w, 0)
        
        count = grid_density.get((i, j), 0)
        if count == 0:
            mesh.VertexColors.Add(Drawing.Color.Black)
        else:
            alpha = math.pow(count / float(max_d), 0.16)
            c_val = grid_color.get((i, j), 0.5)
            
            # طیف خاص و جذاب ۴ مرحله‌ای:
            if c_val < 0.30:
                # ۱. بنفش ارغوانی/مگنتا (غبار بیرونی بازوها)
                f = c_val / 0.30
                r = int((130 + 90 * f) * alpha)
                g = int((15 + 25 * f) * alpha)
                b = int((190 + 55 * f) * alpha)
            elif c_val < 0.65:
                # ۲. آبی فیروزه‌ای و سیان الکتریکی (ستارگان جوان بازوها)
                f = (c_val - 0.30) / 0.35
                r = int((10 + 40 * f) * alpha)
                g = int((180 + 70 * f) * alpha)
                b = int((220 + 35 * f) * alpha)
            elif c_val < 0.88:
                # ۳. طلایی/نارنجی کهربایی (هاله پیرامون هسته)
                f = (c_val - 0.65) / 0.23
                r = int((245 + 10 * f) * alpha)
                g = int((150 + 80 * f) * alpha)
                b = int((30 + 40 * f) * alpha)
            else:
                # ۴. هسته داغ، سفید پلاتینیوم با تراکم شدید
                r = int(255 * alpha)
                g = int(248 * alpha)
                b = int(235 * alpha)
                
            mesh.VertexColors.Add(Drawing.Color.FromArgb(r, g, b))

for j in range(res_val - 1):
    for i in range(res_val - 1):
        p1 = j * res_val + i
        p2 = j * res_val + (i + 1)
        p3 = (j + 1) * res_val + (i + 1)
        p4 = (j + 1) * res_val + i
        mesh.Faces.AddFace(p1, p2, p3, p4)

mesh.Normals.ComputeNormals()
a = mesh
# ---------- end py3_2 ----------
