# Grasshopper definition unnamed.gh (Grasshopper 1.0.8)

number_slider = Slider(500, range=0..500)
number_slider_2 = Slider(500, range=0..500)
py3 = Python3Script(
    c_real=Slider(0.285, range=-2..2),
    c_imag=Slider(0.01, range=-2..2),
    width=number_slider,
    height=number_slider,
    max_iter=Slider(400, range=0..1000),
    bounds=Slider(1.4, range=0..10))  # -> out, a; inputs c_imag: Double, width: Int32, height: Int32, max_iter: Int32, bounds: Double
# ---------- py3: Python ----------
import System.Drawing as Drawing
import Rhino.Geometry as rg

c = complex(c_real, c_imag)

mesh = rg.Mesh()

x_min, x_max = -bounds, bounds
y_min, y_max = -bounds, bounds

for j in range(height):
    y0 = y_min + (y_max - y_min) * j / (height - 1)

    for i in range(width):
        x0 = x_min + (x_max - x_min) * i / (width - 1)

        z = complex(x0, y0)
        iteration = 0

        while abs(z) < 2.0 and iteration < max_iter:
            z = z * z + c
            iteration += 1

        mesh.Vertices.Add(x0, y0, 0)

        if iteration == max_iter:
            color = Drawing.Color.Black
        else:
            val = float(iteration) / max_iter
            r = int(min(255, 255 * (val * 3.5)))
            g = int(min(255, 120 * (val * 2.0)))
            b = int(min(255, 30 * val))

            color = Drawing.Color.FromArgb(r, g, b)
        mesh.VertexColors.Add(color)

for j in range(height - 1):
    for i in range(width - 1):
        p1 = j * width + i
        p2 = j * width + (i + 1)
        p3 = (j + 1) * width + (i + 1)
        p4 = (j + 1) * width + i
        mesh.Faces.AddFace(p1, p2, p3, p4)

mesh.Normals.ComputeNormals()

a = mesh
# ---------- end py3 ----------
