# Grasshopper definition main.gh (Grasshopper 1.0.8)

py3 = Python3Script(
    number_of_stores=Slider(20, range=1..100),
    height_of_stores=Slider(5, range=1..11),
    length=Slider(15, range=1..100),
    width=Slider(24.72, range=1..100),
    fillet=Slider(2.5, range=1..16),
    Divide=Slider(26, range=1..100))  # -> out, a, b, c, srf; inputs number_of_stores: Int32, height_of_stores: Double, width: Double, fillet: Double, Divide: Int32
# ---------- py3: Python ----------
import Rhino.Geometry as rg
import ghpythonlib.components as gh

based_curve = rg.Rectangle3d(rg.Plane.WorldXY, width, length).ToNurbsCurve()
based_curve = rg.Curve.CreateFilletCornersCurve(based_curve, fillet, 0.01, 0.1)

initial_curves = []
for i in range(number_of_stores):
    copied_curve = based_curve.DuplicateCurve()
    vector = rg.Vector3d(0, 0, i * height_of_stores)
    transfor_vector = rg.Transform.Translation(vector)
    copied_curve.Transform(transfor_vector)
    initial_curves.append(copied_curve)

floors_boundary = []

for i in initial_curves:
    floors_boundary.append(i.Offset(rg.Plane.WorldXY, -0.5, 0.01, rg.CurveOffsetCornerStyle.Round)[0])

floors = []

for i in floors_boundary:
    floors.append(rg.Extrusion.Create(i, -0.3, True))

point_matrix = []
for crv in initial_curves:
    t_value = crv.DivideByCount(Divide, True)
    row_pts = []
    for t in t_value:
        row_pts.append(crv.PointAt(t))

    point_matrix.append(row_pts)


lines = []

for i in range(len(point_matrix)):
    sub_lines = []
    if i < len(point_matrix)-1:
        current_pts = point_matrix[i]
        next_pts = point_matrix[i+1]

        for j in range(len(current_pts)):
            if j < len(current_pts) - 1:
                line = rg.Line(current_pts[j], next_pts[j+1])
                line_2 = rg.Line(next_pts[j], current_pts[j+1])

            elif j == len(current_pts) - 1:
                line = rg.Line(current_pts[j], next_pts[0])
                line_2 = rg.Line(next_pts[j], current_pts[0])

            sub_lines.append(line)
            sub_lines.append(line_2)
        lines.append(sub_lines)

mesh = rg.Mesh()
flatten_lines = [j for i in lines for j in i]
radius = 0.2

for line in flatten_lines: 
    plane = rg.Plane(line.From, line.Direction)
    circle = rg.Circle(plane, radius)
    cyl = rg.Cylinder(circle, line.Length)
    mesh_pipe = rg.Mesh.CreateFromCylinder(cyl, 1, 4)
    mesh.Append(mesh_pipe)
    mesh.Weld(3.14)


organic_tower = gh.MultiPipe(flatten_lines, radius, [], 3, 0.5, 0, 0.6, 0)
surface = rg.Brep.CreateFromLoft(floors_boundary, rg.Point3d.Unset, rg.Point3d.Unset, rg.LoftType.Normal, False)

c = organic_tower
srf = floors
b = surface
# ---------- end py3 ----------
panel = Panel(py3.c)
srf = Surface(py3.b)
brep = Brep(py3.c)
brep_2 = Brep(py3.srf)
