# Grasshopper definition unnamed.gh (Grasshopper 1.0.8)
# plug-ins: Weaverbird

pt = ConstructPoint(
    XCoordinate=[Slider(85, range=0..140), Slider(20.12, range=0..50)],
    YCoordinate=0,
    ZCoordinate=[Slider(36.67, range=0..50), Slider(16.53, range=0..50)])
py3 = Python3Script(
    X_Dimension=Slider(50, range=0..50),
    Y_Dimension=Slider(25, range=0..50),
    step=Slider(1.605, range=0..10),
    Attractor_Points=pt,
    Deepth=Slider(-5, range=-5..0),
    Number_of_cells=Slider(1000, range=0..1000),
    Min_scale=Slider(0.005, range=0..1),
    Max_scale=Slider(0.75, range=0..1))  # -> out, Surface; inputs X_Dimension: Int32, Y_Dimension: Int32, step: Double, Attractor_Points: list of Point3d, Deepth: Double, Number_of_cells: Int32, Min_scale: Double
# ---------- py3: Python ----------
import rhinoscriptsyntax as rs
import Rhino.Geometry as rg
import ghpythonlib.components as gh
import random
import math

Points = []

for i in range(Y_Dimension):
    row_pts = []
    for j in range(X_Dimension):
        row_pts.append(rs.CreatePoint(step*j, 0, step*i))

    Points.append(row_pts)



Distances = []
for i in Points:
    sub_list = []
    for j in i:
        dist_1 = rs.Distance(j , Attractor_Points[0])
        dist_2 = rs.Distance(j, Attractor_Points[1])
        min_dist = min(dist_1, dist_2)
        sub_list.append(min_dist)
    Distances.append(sub_list)

min_source = min([dist for i in Distances for dist in i])
max_source = max([dist for i in Distances for dist in i])

def remap(value, min_source, max_source, min_target, max_target):
    remaped_value = ((value - min_source) / (max_source - min_source)) * (max_target - min_target) + min_target
    return remaped_value 

for i in range(len(Distances)):
    for j in range(len(Distances[i])):
        remaped_level_1 = remap(Distances[i][j], min_source, max_source, 1, 0)
        sin_cos = math.sin(1.5*math.pi*remaped_level_1) 
        remaped_level_2 = remap(sin_cos, -1, 1, Deepth, 0)
        pt_x, pt_y = Points[i][j].X, Points[i][j].Z
        pt_new = rs.CreatePoint(pt_x, remaped_level_2, pt_y)
        Points[i][j] = pt_new



curves = [rs.AddInterpCurve(i, degree=3) for i in Points]


surface = rs.AddLoftSrf(curves)

surface = rs.coercebrep(surface)
populated_points = []
num_points = Number_of_cells

u_domain = rs.SurfaceDomain(surface, 0)
v_domain = rs.SurfaceDomain(surface, 1)



pt_1 = rs.CreatePoint(u_domain[0], 0, 0 )
pt_2 = rs.CreatePoint(u_domain[0], v_domain[1], 0)
print(u_domain)
print(v_domain)
line_1 = rs.AddLine(rs.CreatePoint(u_domain[0], 0, 0 ), rs.CreatePoint(v_domain[0], v_domain[1], 0)) #(0,0,0) (0, 54, 0)
line_2 = rs.AddLine(rs.CreatePoint(u_domain[1], 0, 0 ), rs.CreatePoint(u_domain[1], v_domain[1], 0)) #(32, 0, 0) (32, 54)
planar_srf = rs.AddLoftSrf([line_1, line_2])
planar_srf = rs.coercebrep(planar_srf)


for _ in range(num_points):
    u_dom = random.uniform(u_domain[0], u_domain[1])
    v_dom = random.uniform(v_domain[0], v_domain[1])


    pt = rs.EvaluateSurface(planar_srf, u_dom, v_dom)
    populated_points.append(pt)



# rect = rs.AddRectangle(rs.WorldXYPlane(), u_domain[1], v_domain[1])
# rect = rs.coercecurve(rect)
rect = rg.Rectangle3d(rs.WorldXYPlane(), u_domain[1], v_domain[1])

voronoi_cells = gh.Voronoi(populated_points, 5, rect)
mapped_curves = gh.MaptoSurface(voronoi_cells,planar_srf, surface)

centers = []

for i in mapped_curves:
    div = gh.DivideCurve(i, 100, False)[0]
    centers.append(gh.Average(div))

reshape = []
dist_center = []

for i in centers:
    dist_1 = gh.Distance(i, Attractor_Points[0])
    dist_2 = gh.Distance(i, Attractor_Points[1])
    dist_center.append(min(dist_1, dist_2))

for i in range(len(mapped_curves)):
    new_val = remap(dist_center[i], min(dist_center), max(dist_center), Max_scale, Min_scale)
    center = centers[i]
    shape = mapped_curves[i]
    scaled = gh.Scale(shape, center, new_val)[0]
    reshape.append(scaled)

a = mapped_curves
d = reshape

final_shape = []
for i, j in zip(mapped_curves, reshape):
    srf = gh.Loft([i, j])
    final_shape.append(srf)

Surface= final_shape
# ---------- end py3 ----------
brep = Brep(py3.Surface)
join = BrepJoin(Breps=brep)  # -> Breps, Closed
mesh = Mesh(join.Breps)
wbjoin = WeaverbirdsJoinMeshesAndWeld(Mesh=mesh, Weld=False)
wbsplitquads = WeaverbirdsConstantQuadsSplitSubdivision(MeshCurves=wbjoin, Level="2", SmoothNakedEdges=1)
wbthicken = WeaverbirdsMeshThicken(MeshCurves=wbsplitquads, Distance="0.2", OffsetType=0)
