# Grasshopper definition main.gh (Grasshopper 1.0.8)

merge = Merge(
    Data1=Slider(8.47, range=0..10),
    Data2=Slider(4.08, range=0..5),
    Data3=Slider(3.82, range=0..5),
    Data4=Slider(0, range=0..2))
merge_2 = Merge(
    Data1=Slider(61.3, range=0..100),
    Data2=Slider(22.48, range=0..100),
    Data3=Slider(10.31, range=0..100),
    Data4=Slider(7.5, range=0..100))
merge_3 = Merge(
    Data1=Slider(0, range=0..50),
    Data2=Slider(13.09, range=0..50),
    Data3=Slider(31.84, range=0..50),
    Data4=Slider(60.99, range=0..110))
merge_4 = Merge(Data1=Slider(3, range=0..50), Data2=Slider(7, range=0..50), Data3=Slider(11, range=0..50))
py3 = Python3Script(
    Circles_Radius=merge_2,
    Circles_Height=merge_3,
    Divide_Count=Slider(48, range=0..100),
    Shift_Points=merge_4,
    Shift_Z_Points=merge)  # -> out, a, b, lines; inputs Circles_Radius: list of Double, Circles_Height: list of Double, Divide_Count: Int32, Shift_Points: list of Int32, Shift_Z_Points: list of Double
# ---------- py3: Python ----------
import Rhino.Geometry as rg

# Defining Initial Circles
#Method one
# circles = []
# for i in range(len(Circles_Radius)):
#     plane = rg.Plane(rg.Point3d(0, 0, Circles_Height[i]), rg.Vector3d(0, 0, 1))
#     cir = rg.Circle(plane, Circles_Radius[i])
#     circles.append(cir)

#Method Two
circles = [rg.Circle(rg.Plane(rg.Point3d(0,0,Circles_Height[i]), rg.Vector3d(0,0,1)), Circles_Radius[i]) for i in range(len(Circles_Radius))]
a = circles

divided_points = []

for i in range(len(circles)):
    if i < 3:
        sub_list = []
        cir = circles[i].ToNurbsCurve()
        t_values = cir.DivideByCount(Divide_Count, True)
        for t in range(len(t_values)):
            sub_list.append(cir.PointAt(t_values[t]))

        divided_points.append(sub_list)

    elif i == 3:
        sub_list = []
        cir = circles[i].ToNurbsCurve()
        t_values = cir.DivideByCount(Divide_Count//2, True)
        for t in range(len(t_values)):
            sub_list.append(cir.PointAt(t_values[t]))

        divided_points.append(sub_list)

divided_shifted_points = []

for i in range(len(divided_points)):
    sub_list = []
    for pt in divided_points[i]:
        new_pt = pt + rg.Vector3d(0, 0, Shift_Z_Points[i])
        sub_list.append(new_pt)
    divided_shifted_points.append(sub_list)


spiral_curves = []
base_count = len(divided_points[0])
top_count = len(divided_points[3])

shift_1 = 3
shift_2 = 7
shift_3 = 11

for j in range(base_count):
    pt0 = divided_points[0][j]
    pt1 = divided_points[1][(j + Shift_Points[0]) % base_count]
    pt2 = divided_points[2][(j + Shift_Points[1]) % base_count]

    index_top = ((j + Shift_Points[2]) // 2) % top_count
    pt3 = divided_points[3][index_top]

    pts_list = [pt0, pt1, pt2, pt3]
    curve = rg.Curve.CreateInterpolatedCurve(pts_list, 3)
    spiral_curves.append(curve)


spiral_curves_1 = []
for j in range(base_count):
    pt0 = divided_shifted_points[0][j]
    pt1 = divided_shifted_points[1][(j + Shift_Points[0]) % base_count]
    pt2 = divided_shifted_points[2][(j + Shift_Points[1]) % base_count]

    index_top = ((j + Shift_Points[2]) // 2) % top_count
    pt3 = divided_shifted_points[3][index_top]

    pts_list = [pt0, pt1, pt2, pt3]
    curve = rg.Curve.CreateInterpolatedCurve(pts_list, 3)
    spiral_curves_1.append(curve)

lacing_count = 50
lacing_lines = []

start_index = Shift_Points[2] % 2

for i in range(start_index, len(spiral_curves), 2):
    index_A = i
    index_B = (i + 1) % len(spiral_curves)
    index_C = (i + 1) % len(spiral_curves)

    crvA = spiral_curves[index_A]
    crvB = spiral_curves_1[index_B]
    crvC = spiral_curves[index_C]

    t_A = crvA.DivideByCount(lacing_count, True)
    t_B = crvB.DivideByCount(lacing_count, True)
    t_C = crvC.DivideByCount(lacing_count, True)

    for t1, t2, t3 in zip(t_A, t_B, t_C):
        ptA = crvA.PointAt(t1)
        ptB = crvB.PointAt(t2)
        ptC = crvC.PointAt(t3)
        pts = [ptA, ptB, ptC, ptA]
        line = rg.PolylineCurve(pts)  
         
        lacing_lines.append(line)

lines = lacing_lines
a = spiral_curves
b = spiral_curves_1[::2]
# ---------- end py3 ----------
crv = Curve([py3.b, py3.a])
crv_2 = Curve(py3.lines)
vpipe = PipeVariable(Parameters="0", Radii="0.3", Caps=0, FitRail=False)
vpipe_2 = PipeVariable(Parameters="0", Radii="0.1", Caps=0, FitRail=False)
