# Grasshopper definition Just algorithm.gh (Grasshopper 1.0.8)
# plug-ins: DendroGH

polygon = Polygon(Plane=PlaneXY(0, 0, 0), Radius="50", Segments="12", FilletRadius=0)  # -> Polygon, Length
disc = Discontinuity(Curve=polygon.Polygon, Level=1)  # -> Points, Parameters
lng = ListLength(List=disc.Points)
range = Range(Domain="0 to 1", Steps=expr("x-1", lng))
crv = Curve(<curve referenced from the Rhino model>)
graph = GraphMapper(range, x0=0, x1=1, y0=0, y1=1, container_name="Bezier", cpx=[0, 0, 1, 1], cpy=[0, 1, 1, 0])
area = Area(Geometry=polygon.Polygon)  # -> Area, Centroid
dom = ConstructDomain(DomainStart="0.1", DomainEnd=Slider(350, range=0..350))
dom_2 = ConstructDomain(DomainStart=Slider(1, range=1..4), DomainEnd=Slider(2.13, range=1..4))
remap = RemapNumbers(Value=graph, Source=Domain(0, 1), Target=dom)  # -> Mapped, Clipped
remap_2 = RemapNumbers(Value=graph, Source=Domain(0, 1), Target=dom_2)  # -> Mapped, Clipped
Z = UnitZ(Factor=remap.Mapped)
divide = DivideCurve(Curve=crv, Count=Slider(2000, range=0..6000), Kinks=False)  # -> Points, Tangents, Parameters
intcrv = Interpolate(Vertices=disc.Points, Degree=3, Periodic=False, KnotStyle=1)  # -> Curve, Length, Domain
scale = Scale(Geometry=disc.Points, Center=area.Centroid, Factor=remap_2.Mapped)  # -> Geometry, Transform
shift = ShiftList(List=divide.Points, Shift=1, Wrap=True)
lng_2 = ListLength(List=scale.Geometry)  # -> expr("x -1", flatten(Length))
srf = Surface(<surface referenced from the Rhino model>)
ln = Line(StartPoint=divide.Points, EndPoint=shift)
item = ListItem(List=scale.Geometry, Index=["0", lng_2], Wrap=True)  # -> flatten(Item)
rotate = Rotate(Geometry=scale.Geometry, Angle=degrees("90"), Plane=area.Centroid)  # -> Geometry, Transform
mesh = MeshBrep(
    Brep=srf,
    Settings={GridMaxCount=0, GridMinCount=16, JaggedSeams=False, MaxEdgeLength=0, MinEdgeLength=0.0001, MinTolerance=0, Refine=True, RefineAngle=0, RelativeTolerance=0.65, SimplePlanes=True, Tolerance=0})
shift_2 = ShiftList(List=ln, Shift=1, Wrap=True)
onmesh = OnMesh(Points=divide.Points, Mesh=mesh, Strength="1000")
length_line = LengthLine(Line=ln, Length=Slider(26.14, range=0..100), Strength=10)
collider = Collider(Objects=ln, Radii=Slider(3.65, range=0..5), Strength="100")
angle = Angle(LineA=ln, LineB=shift_2, Strength="2000")
replace = ReplaceItems(List=rotate.Geometry, Item=item, Indices=["0", lng_2], Wrap=False)
crv_2 = Curve(<curve referenced from the Rhino model>)
move = Move(Geometry=replace, Motion=Z)  # -> Geometry, Transform
bouncysolver = BouncySolver(
    GoalObjects=flatten([onmesh, length_line, collider, angle]),
    Reset=Button(),
    Threshold=1e-15,
    Tolerance=0.0001,
    Damping=Slider(1, range=0..1),
    Iterations=10,
    On=Toggle(False))  # -> I, V, O
intcrv_2 = Interpolate(Vertices=move.Geometry, Degree=3, Periodic=False, KnotStyle=1)  # -> Curve, Length, Domain
loft = Loft(
    Curves=flatten([intcrv.Curve, intcrv_2.Curve]),
    Options={Adjust=False, Closed=False, LoftEnds=0, LoftSimp=0, LoftType=0, Rebuild=10, Refit=0.01})
crv_3 = Curve(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)
intcrv_3 = Interpolate(Vertices=bouncysolver.V, Degree=3, Periodic=invert(False), KnotStyle=1)  # -> Curve, Length, Domain
divide_2 = DivideCurve(Curve=crv_3, Count=Slider(2000, range=0..6000), Kinks=False)  # -> Points, Tangents, Parameters
shift_3 = ShiftList(List=divide_2.Points, Shift=1, Wrap=True)
srf_2 = Surface(loft)
ln_2 = Line(StartPoint=divide_2.Points, EndPoint=shift_3)
mesh_2 = MeshBrep(
    Brep=srf_2,
    Settings={GridMaxCount=0, GridMinCount=16, JaggedSeams=False, MaxEdgeLength=0, MinEdgeLength=0.0001, MinTolerance=0, Refine=True, RefineAngle=0, RelativeTolerance=0.65, SimplePlanes=True, Tolerance=0})
shift_4 = ShiftList(List=ln_2, Shift=1, Wrap=True)
onmesh_2 = OnMesh(Points=divide_2.Points, Mesh=mesh_2, Strength="10000")
length_line_2 = LengthLine(Line=ln_2, Length=Slider(10, range=0..100), Strength=10)
collider_2 = Collider(Objects=ln_2, Radii=Slider(1.14, range=0..5), Strength="300")
angle_2 = Angle(LineA=ln_2, LineB=shift_4, Strength="1500")
bouncysolver_2 = BouncySolver(
    GoalObjects=flatten([onmesh_2, length_line_2, collider_2, angle_2]),
    Reset=Button(),
    Threshold=1e-15,
    Tolerance=0.0001,
    Damping=Slider(1, range=0..1),
    Iterations=10,
    On=Toggle(False))  # -> I, V, O
crv_4 = Curve(srf_2)
intcrv_4 = Interpolate(Vertices=bouncysolver_2.V, Degree=3, Periodic=invert(False), KnotStyle=1)  # -> Curve, Length, Domain
vsettings = CreateSettings(VoxelSize="0.1", Bandwidth=1, Isovalue=0, Adaptivity=0.1)
vcurve = CurveToVolume(Curves=intcrv_4.Curve, CurveRadius="0.5", Settings=vsettings)
vsettings_2 = CreateSettings(VoxelSize="0.1", Bandwidth=1, Isovalue=0, Adaptivity=0.1)
vcurve_2 = CurveToVolume(Curves=crv_4, CurveRadius="1", Settings=vsettings_2)
