# Grasshopper definition main.gh (Grasshopper 1.0.8)

srf = Surface(<surface referenced from the Rhino model>)
mesh = Mesh(srf)
triremesh = TriRemesh(Geometry=mesh, Iterations=25)  # -> Triangulation, Dual, Creases
py3 = Python3Script(
    target_mesh=triremesh.Triangulation,
    seed_val=Slider(44, range=0..100),
    num_seeds=Slider(13, range=0..100),
    spring_k=Slider(0.253, range=0..2),
    target_dist=Slider(1.119, range=0..2),
    rep_radius=Slider(3.242, range=0..5),
    rep_k=Slider(0.514, range=0..2),
    reset=Button(),
    play=Toggle(False))  # -> out, pts_out, curve_out; inputs target_mesh: Mesh, seed_val: Int32, num_seeds: Int32, spring_k: Double, target_dist: Double, rep_radius: Double, rep_k: Double, reset: Boolean, play: Boolean
# ---------- py3: Python ----------
import Rhino.Geometry as rg
import random

class GrowthNode:
    def __init__(self, position):
        self.pos = rg.Point3d(position)
        self.vel = rg.Vector3d(0,0,0)
        self.acc = rg.Vector3d(0, 0, 0)

    def reset_force(self, ):
            self.vel = rg.Vector3d(0, 0, 0)

    def add_force(self, force_vector):
            self.vel += force_vector

    def update(self, damp=0.5):
        self.vel += self.acc
        self.vel *= damp
        self.pos += self.vel

def apply_structural_forces(nodes, spring_k=0.2, target_dist=1.0):
    n = len(nodes)
    if n < 3:
        return

    for i in range(n):
        curr_node = nodes[i]
        prev_node = nodes[(i-1) % n]
        next_node = nodes[(i+1) % n]

        vec_prev = prev_node.pos - curr_node.pos
        dist_prev = vec_prev.Length

        if dist_prev > 0:
            dir_prev = rg.Vector3d(vec_prev)
            dir_prev.Unitize()
            force_prev = dir_prev * (dist_prev - target_dist) * spring_k
            curr_node.add_force(force_prev)

        vec_next = next_node.pos - curr_node.pos
        dist_next = vec_next.Length

        if dist_next > 0:
            dir_next = rg.Vector3d(vec_next)
            dir_next.Unitize()
            force_next = dir_next * (dist_next - target_dist) * spring_k
            curr_node.add_force(force_next)   
     
if "nodes" not in globals() or reset:
    nodes = []

    if target_mesh and target_mesh.IsValid:
        random.seed(seed_val)

        total_face = target_mesh.Faces.Count
        count = min(num_seeds, total_face)

        random_face_indices = random.sample(range(total_face), count)
        print(random_face_indices)
        for idx in random_face_indices:
            pt = target_mesh.Faces.GetFaceCenter(idx)
            nodes.append(GrowthNode(pt))



def apply_repulsion_forces(nodes, rep_radius=3.0, rep_k=0.5):
    num_nodes = len(nodes)
    if num_nodes < 2:
        return

    for i in range(num_nodes):
        curr_node = nodes[i]

        for j in range(i+1, num_nodes):
            other_nodes = nodes[j]

            vec = other_nodes.pos - curr_node.pos
            dist = vec.Length

            if 0 < dist < rep_radius:
                direction = rg.Vector3d(vec)
                direction.Unitize()

                strength = (1.0 - (dist / rep_radius)) * rep_k

                rep_force_curr = direction * (-strength)
                rep_force_other = direction * (strength)

                curr_node.add_force(rep_force_curr)
                other_nodes.add_force(rep_force_other)

def divide_nodes(nodes, split_threshold=1.8, max_nodes=500):
    n = len(nodes)
    if n < 3 or n >= max_nodes:
        return nodes
    
    new_nodes = []

    for i in range(n):
        curr_node = nodes[i]
        next_node = nodes[(i+1) % n]

        new_nodes.append(curr_node)
        dist = curr_node.pos.DistanceTo(next_node.pos)

        if dist > split_threshold and len(new_nodes) < max_nodes:
            mid_point = (curr_node.pos + next_node.pos) * 0.5

            new_node = GrowthNode(mid_point)
            new_node.vel = (curr_node.vel + next_node.vel ) * 0.5
            new_nodes.append(new_node)

    return new_nodes

def constrain_to_mesh(nodes, target_mesh):
    if not target_mesh or not target_mesh.IsValid:
        return

    for node in nodes:
        projected_pt = target_mesh.ClosestPoint(node.pos)

        if projected_pt.IsValid:
            node.pos = projected_pt

if "nodes" in globals() and len(nodes) > 0 and play:
    for node in nodes:
        node.reset_force()
    apply_structural_forces(nodes, spring_k, target_dist)
    apply_repulsion_forces(nodes, rep_radius, rep_k)
    for node in nodes:
        node.update(damp=0.85)

    constrain_to_mesh(nodes, target_mesh)
    nodes = divide_nodes(nodes, 1.8, 500)
    ghenv.Component.ExpireSolution(True)

pts_out = [node.pos for node in nodes] if 'nodes' in globals() else []

if len(pts_out) > 3:
    close_pts = pts_out + [pts_out[0]]
    curve_out = rg.Curve.CreateInterpolatedCurve(close_pts, 3)

else:
    curve_out = None
# ---------- end py3 ----------
crv = Curve(py3.curve_out)
