# Grasshopper definition main2.gh (Grasshopper 1.0.8)
# plug-ins: DendroGH

crv = Curve(<curve referenced from the Rhino model>)
series = Series(Start=0, Step=1, Count="10")
Z = UnitZ(Factor=series)
move = Move(Geometry=crv, Motion=Z)  # -> Geometry, Transform
area = Area(Geometry=move.Geometry)  # -> Area, Centroid
panel = Panel("12")
polygon = Polygon(Plane=PlaneXY(0, 0, 0), Radius="20", Segments=Slider(12.23, range=0..20), FilletRadius=0)  # -> Polygon, Length
range = Range(Domain="0 to 90", Steps=expr("x -1", "10"))
range_2 = Range(Domain="0 to 1", Steps=expr("x -1", "10"))
disc = Discontinuity(Curve=polygon.Polygon, Level=1)  # -> Points, Parameters
dom = ConstructDomain(DomainStart=0, DomainEnd=1)
crv_2 = Curve(polygon.Polygon)
panel_2 = Panel("100")
rotate = Rotate(Geometry=move.Geometry, Angle=degrees(range), Plane=area.Centroid)  # -> Geometry, Transform
lng = ListLength(List=disc.Points)
graph = GraphMapper(
    range_2,
    x0=0,
    x1=1,
    y0=0,
    y1=1,
    container_name="Sine",
    Equation_px=[0.1086956486, 0.4391302466],
    Equation_py=[0.8681158423, 0.07971012592])
range_3 = Range(Domain=Domain(0, 1), Steps=expr("x - 1", lng))
area_2 = Area(Geometry=rotate.Geometry)  # -> Area, Centroid
area_3 = Area(Geometry=polygon.Polygon)  # -> Area, Centroid
dom_2 = ConstructDomain(DomainStart=Slider(1, range=1..3), DomainEnd=Slider(2.12, range=1..3))
graph_2 = GraphMapper(range_3, x0=0, x1=1, y0=0, y1=1, container_name="Bezier", cpx=[0, 0, 1, 1], cpy=[0, 1, 1, 0])
remap = RemapNumbers(Value=graph_2, Source=Domain(0, 1), Target=dom_2)  # -> Mapped, Clipped
remap_2 = RemapNumbers(Value=graph, Source=Domain(0, 1), Target=" 0.6 to 0.9")  # -> Mapped, Clipped
scale = Scale(Geometry=disc.Points, Center=area_3.Centroid, Factor=remap.Clipped)  # -> Geometry, Transform
scale_2 = Scale(Geometry=rotate.Geometry, Center=area_2.Centroid, Factor=remap_2.Mapped)  # -> Geometry, Transform
multiplication = Multiplication(A=graph_2, B=Slider(150, range=0..500))
loft = Loft(
    Curves=scale_2.Geometry,
    Options={Adjust=False, Closed=False, LoftEnds=0, LoftSimp=0, LoftType=0, Rebuild=10, Refit=0.01})
lng_2 = ListLength(List=scale.Geometry)  # -> expr("x - 1", flatten(Length))
rotate_2 = Rotate(Geometry=scale.Geometry, Angle=expr("-x", degrees(Slider(90, range=0..90))), Plane=area_3.Centroid)  # -> Geometry, Transform
crv_3 = Curve(<curve referenced from the Rhino model>)
item = ListItem(List=scale.Geometry, Index=["0", lng_2], Wrap=True)  # -> flatten(Item)
panel_4 = Panel(lng_2)
replace = ReplaceItems(List=rotate_2.Geometry, Item=item, Indices=["0", lng_2], Wrap=False)
Z_2 = UnitZ(Factor=multiplication)
nurbs = NurbsCurve(Vertices=disc.Points, Degree=3, Periodic=False)  # -> Curve, Length, Domain
move_2 = Move(Geometry=replace, Motion=Z_2)  # -> Geometry, Transform
nurbs_2 = NurbsCurve(Vertices=move_2.Geometry, Degree=3, Periodic=False)  # -> Curve, Length, Domain
loft_2 = Loft(
    Curves=flatten([nurbs.Curve, nurbs_2.Curve]),
    Options={Adjust=False, Closed=False, LoftEnds=0, LoftSimp=0, LoftType=0, Rebuild=10, Refit=0.01})
crv_4 = Curve(crv_2)
srf = Surface(loft_2)
crv_5 = Curve(<curve referenced from the Rhino model>)
py3 = Python3Script(
    curve=crv_5,
    target_surface=srf,
    count=Slider(700, range=0..700),
    radius=Slider(2.361, range=0..5),
    k_rep=Slider(1.001, range=0..2),
    rest_length=Slider(0.68, range=0..2),
    k_spring=Slider(0.48, range=0.1..0.8),
    k_smooth=Slider(0.307, range=0.05..0.4),
    max_length=Slider(1.256, range=0.05..2),
    max_nodes=Slider(40000, range=0..40000),
    reset=Button(),
    run=Toggle(False))  # -> out, out_points, out_curve; inputs curve: Curve, target_surface: Surface, count: Int32, radius: Double, k_rep: Double, rest_length: Double, k_spring: Double, k_smooth: Double, max_length: Double, max_nodes: Int32, reset: Boolean, run: Boolean
# ---------- py3: Python ----------
import Rhino
import Rhino.Geometry as rg
import math

class Node:
    def __init__(self, position):
        self.position = rg.Point3d(position) if isinstance(position, rg.Point3d) else rg.Point3d(0, 0, 0)
        self.force = rg.Vector3d(0, 0, 0)

    def reset_force(self):
        self.force = rg.Vector3d(0, 0, 0)

    def add_force(self, force_vector):
        if isinstance(force_vector, rg.Vector3d):
            self.force.X += force_vector.X
            self.force.Y += force_vector.Y
            self.force.Z += force_vector.Z

    def update_position(self, max_move=0.15):
        len_sq = self.force.X**2 + self.force.Y**2 + self.force.Z**2
        if len_sq > (max_move * max_move) and len_sq > 0:
            scale = max_move / math.sqrt(len_sq)
            self.force.X *= scale
            self.force.Y *= scale
            self.force.Z *= scale
        
        self.position.X += self.force.X
        self.position.Y += self.force.Y
        self.position.Z += self.force.Z


class DifferentialGrowthFast:
    def __init__(self, curve, target_surface=None, count=30, radius=2.0, k_rep=0.5, 
                 rest_length=1.0, k_spring=0.4, k_smooth=0.2, max_length=1.5, max_nodes=800):
        
        self.target_brep = None
        self.boundary_curves = []

        if target_surface:
            if isinstance(target_surface, rg.Brep):
                self.target_brep = target_surface
            elif hasattr(target_surface, "ToBrep"):
                self.target_brep = target_surface.ToBrep()
            elif isinstance(target_surface, rg.Surface):
                self.target_brep = rg.Brep.CreateFromSurface(target_surface)

            if self.target_brep:
                for edge in self.target_brep.Edges:
                    self.boundary_curves.append(edge.EdgeCurve)

        self.count = count
        self.radius = radius            
        self.radius_sq = radius * radius
        self.k_rep = k_rep              
        self.rest_length = rest_length  
        self.k_spring = k_spring        
        self.k_smooth = k_smooth        
        self.max_length = max_length    
        self.max_nodes = max_nodes      

        self.is_closed = curve.IsClosed if curve else False

        initial_points = self._resample_curve_safe(curve, count)
        self.nodes = [Node(pt) for pt in initial_points if isinstance(pt, rg.Point3d)]

        if self.target_brep:
            self.project_to_surface()

    def _resample_curve_safe(self, crv, num_pts):
        if not crv or num_pts < 2:
            return []
        pts = []
        domain = crv.Domain
        step = (domain.Max - domain.Min) / float(num_pts)
        for i in range(num_pts):
            pt = crv.PointAt(domain.Min + step * i)
            if pt.IsValid:
                pts.append(pt)
        return pts

    def _clamp_to_closest_boundary(self, pt):
        min_d = float('inf')
        best_pt = pt
        for crv in self.boundary_curves:
            success, t = crv.ClosestPoint(pt)
            if success:
                edge_pt = crv.PointAt(t)
                dx = pt.X - edge_pt.X
                dy = pt.Y - edge_pt.Y
                dz = pt.Z - edge_pt.Z
                d = dx*dx + dy*dy + dz*dz
                if d < min_d:
                    min_d = d
                    best_pt = edge_pt
        return best_pt

    def project_to_surface(self):
        if not self.target_brep:
            return

        for node in self.nodes:
            cp = self.target_brep.ClosestPoint(node.position)
            if not (cp and cp.IsValid):
                node.position = self._clamp_to_closest_boundary(node.position)
                continue

            is_inside = False
            for face in self.target_brep.Faces:
                success, u, v = face.ClosestPoint(cp)
                if success:
                    rel = face.IsPointOnFace(u, v)
                    if rel == rg.PointFaceRelation.Interior or rel == rg.PointFaceRelation.Boundary:
                        is_inside = True
                        break

            if is_inside:
                node.position = cp
            else:
                node.position = self._clamp_to_closest_boundary(cp)

    def compute_repulsion_fast(self):
        n = len(self.nodes)
        if n < 2:
            return

        cell_size = self.radius
        grid = {}

        for idx, node in enumerate(self.nodes):
            cell_x = int(math.floor(node.position.X / cell_size))
            cell_y = int(math.floor(node.position.Y / cell_size))
            cell_z = int(math.floor(node.position.Z / cell_size))
            key = (cell_x, cell_y, cell_z)

            if key not in grid:
                grid[key] = []
            grid[key].append(idx)

        neighbor_offsets = [
            (dx, dy, dz)
            for dx in (-1, 0, 1)
            for dy in (-1, 0, 1)
            for dz in (-1, 0, 1)
        ]

        visited_pairs = set()

        for key, node_indices in grid.items():
            cx, cy, cz = key
            neighbor_indices = []
            for dx, dy, dz in neighbor_offsets:
                neighbor_key = (cx + dx, cy + dy, cz + dz)
                if neighbor_key in grid:
                    neighbor_indices.extend(grid[neighbor_key])

            for i in node_indices:
                node_a = self.nodes[i]
                pos_a = node_a.position

                for j in neighbor_indices:
                    if i >= j:
                        continue
                    
                    pair_key = (i, j)
                    if pair_key in visited_pairs:
                        continue
                    visited_pairs.add(pair_key)

                    node_b = self.nodes[j]
                    pos_b = node_b.position

                    dx = pos_a.X - pos_b.X
                    dy = pos_a.Y - pos_b.Y
                    dz = pos_a.Z - pos_b.Z

                    dist_sq = dx*dx + dy*dy + dz*dz

                    if 0 < dist_sq < self.radius_sq:
                        dist = math.sqrt(dist_sq)
                        inv_dist = 1.0 / dist
                        
                        nx = dx * inv_dist
                        ny = dy * inv_dist
                        nz = dz * inv_dist

                        strength = (1.0 - (dist / self.radius)) * self.k_rep

                        rep_vector = rg.Vector3d(nx * strength, ny * strength, nz * strength)
                        node_a.add_force(rep_vector)
                        node_b.add_force(-rep_vector)

    def compute_springs(self):
        n = len(self.nodes)
        if n < 2:
            return

        loop_count = n if self.is_closed else n - 1

        for i in range(loop_count):
            node_a = self.nodes[i]
            node_b = self.nodes[(i + 1) % n]

            dir_vec = rg.Vector3d(node_b.position - node_a.position)
            # اصلاح‌شده: استفاده مستقیم از فرمول مجذور طول برای سازگاری کامل با Rhino 8 CPython
            dist_sq = dir_vec.X**2 + dir_vec.Y**2 + dir_vec.Z**2

            if dist_sq > 0:
                dist = math.sqrt(dist_sq)
                delta = dist - self.rest_length

                factor = (delta * self.k_spring) / dist
                spring_a = dir_vec * factor
                spring_b = dir_vec * (-factor)

                node_a.add_force(spring_a)
                node_b.add_force(spring_b)

    def compute_smoothing(self):
        n = len(self.nodes)
        if n < 3:
            return

        for i in range(n):
            if not self.is_closed and (i == 0 or i == n - 1):
                continue

            prev_pos = self.nodes[(i - 1) % n].position
            curr_node = self.nodes[i]
            next_pos = self.nodes[(i + 1) % n].position

            mid_x = (prev_pos.X + next_pos.X) * 0.5
            mid_y = (prev_pos.Y + next_pos.Y) * 0.5
            mid_z = (prev_pos.Z + next_pos.Z) * 0.5

            smooth_vec = rg.Vector3d(
                (mid_x - curr_node.position.X) * self.k_smooth,
                (mid_y - curr_node.position.Y) * self.k_smooth,
                (mid_z - curr_node.position.Z) * self.k_smooth
            )
            curr_node.add_force(smooth_vec)

    def constrain_forces_to_tangent(self):
        if not self.target_brep:
            return

        for node in self.nodes:
            f_len_sq = node.force.X**2 + node.force.Y**2 + node.force.Z**2
            if f_len_sq > 0.000001:
                cp = self.target_brep.ClosestPoint(node.position)
                if cp and cp.IsValid:
                    for face in self.target_brep.Faces:
                        success, u, v = face.ClosestPoint(cp)
                        if success:
                            normal = face.NormalAt(u, v)
                            n_len_sq = normal.X**2 + normal.Y**2 + normal.Z**2
                            if n_len_sq > 0:
                                normal.Unitize()
                                dot = node.force.X * normal.X + node.force.Y * normal.Y + node.force.Z * normal.Z
                                node.force.X -= normal.X * dot
                                node.force.Y -= normal.Y * dot
                                node.force.Z -= normal.Z * dot
                            break

    def split_edges(self):
        if len(self.nodes) >= self.max_nodes:
            return

        new_nodes = []
        n = len(self.nodes)
        loop_count = n if self.is_closed else n - 1
        max_len_sq = self.max_length * self.max_length

        for i in range(loop_count):
            node_a = self.nodes[i]
            node_b = self.nodes[(i + 1) % n]

            new_nodes.append(node_a)

            dx = node_a.position.X - node_b.position.X
            dy = node_a.position.Y - node_b.position.Y
            dz = node_a.position.Z - node_b.position.Z
            dist_sq = dx*dx + dy*dy + dz*dz

            if dist_sq > max_len_sq and (len(self.nodes) + len(new_nodes)) < self.max_nodes:
                mid_pt = rg.Point3d(
                    (node_a.position.X + node_b.position.X) * 0.5,
                    (node_a.position.Y + node_b.position.Y) * 0.5,
                    (node_a.position.Z + node_b.position.Z) * 0.5
                )
                new_nodes.append(Node(mid_pt))

        if not self.is_closed:
            new_nodes.append(self.nodes[-1])

        self.nodes = new_nodes

    def update(self):
        max_step = self.rest_length * 0.15
        for node in self.nodes:
            node.update_position(max_move=max_step)

        if self.target_brep:
            self.project_to_surface()

    def step(self):
        for node in self.nodes:
            node.reset_force()

        self.compute_repulsion_fast()
        self.compute_springs()
        self.compute_smoothing()

        self.constrain_forces_to_tangent()

        self.update()
        self.split_edges()

    def get_points(self):
        return [node.position for node in self.nodes]

    def get_curve(self):
        pts = self.get_points()
        if len(pts) < 2:
            return None
        if self.is_closed:
            pts.append(pts[0])
        return rg.Curve.CreateControlPointCurve(pts, degree=3)


# ===================================================
# بخش اجرای گرس‌هاپر
# ===================================================

if 'solver' not in globals() or (reset if 'reset' in globals() else False):
    if 'curve' in globals() and curve:
        c_val = count if 'count' in globals() and count else 30
        r_val = radius if 'radius' in globals() and radius else 2.0
        kr_val = k_rep if 'k_rep' in globals() and k_rep else 0.3

        rl_val = rest_length if 'rest_length' in globals() and rest_length else 1.0
        ks_val = k_spring if 'k_spring' in globals() and k_spring else 0.4
        ksm_val = k_smooth if 'k_smooth' in globals() and k_smooth else 0.3
        ml_val = max_length if 'max_length' in globals() and max_length else 1.5
        mn_val = max_nodes if 'max_nodes' in globals() and max_nodes else 800

        surf = target_surface if 'target_surface' in globals() else None

        solver = DifferentialGrowthFast(
            curve, target_surface=surf, count=c_val, 
            radius=r_val, k_rep=kr_val, rest_length=rl_val, 
            k_spring=ks_val, k_smooth=ksm_val, max_length=ml_val, max_nodes=mn_val
        )

if 'solver' in globals() and solver:
    is_running = run if 'run' in globals() else False

    if is_running:
        solver.step()
        ghenv.Component.ExpireSolution(True)

    out_points = solver.get_points()
    out_curve = solver.get_curve()
# ---------- end py3 ----------
crv_6 = Curve(loft_2)
crv_7 = Curve(py3.out_curve)
vsettings = CreateSettings(VoxelSize=Slider(0.1, range=0..1), Bandwidth=1, Isovalue=0, Adaptivity=0.1)
vsettings_2 = CreateSettings(VoxelSize=Slider(0.1, range=0..1), Bandwidth=1, Isovalue=0, Adaptivity=0.1)
vcurve = CurveToVolume(Curves=crv_7, CurveRadius="0.3", Settings=vsettings)
vcurve_2 = CurveToVolume(Curves=crv_6, CurveRadius="0.7", Settings=vsettings_2)
