# Grasshopper definition unnamed.gh (Grasshopper 1.0.8)

panel = Panel("12")
polygon = Polygon(Plane=PlaneXY(0, 0, 0), Radius="20", Segments=Slider(12.23, range=0..20), FilletRadius=0)  # -> Polygon, Length
disc = Discontinuity(Curve=polygon.Polygon, Level=1)  # -> Points, Parameters
crv = Curve(polygon.Polygon)
panel_2 = Panel("100")
lng = ListLength(List=disc.Points)
range = Range(Domain=Domain(0, 1), Steps=expr("x - 1", lng))
area = Area(Geometry=polygon.Polygon)  # -> Area, Centroid
dom = ConstructDomain(DomainStart=Slider(1, range=1..3), DomainEnd=Slider(2.12, range=1..3))
graph = GraphMapper(range, x0=0, x1=1, y0=0, y1=1, container_name="Bezier", cpx=[0, 0, 1, 1], cpy=[0, 1, 1, 0])
divide = DivideCurve(Curve=crv, Count=Slider(3, range=0..1000), Kinks=False)  # -> Points, Tangents, Parameters
remap = RemapNumbers(Value=graph, Source=Domain(0, 1), Target=dom)  # -> Mapped, Clipped
scale = Scale(Geometry=disc.Points, Center=area.Centroid, Factor=remap.Clipped)  # -> Geometry, Transform
multiplication = Multiplication(A=graph, B=Slider(150, range=0..500))
lng_2 = ListLength(List=scale.Geometry)  # -> expr("x - 1", flatten(Length))
rotate = Rotate(Geometry=scale.Geometry, Angle=expr("-x", degrees(Slider(90, range=0..90))), Plane=area.Centroid)  # -> Geometry, Transform
item = ListItem(List=scale.Geometry, Index=["0", lng_2], Wrap=True)  # -> flatten(Item)
panel_4 = Panel(lng_2)
replace = ReplaceItems(List=rotate.Geometry, Item=item, Indices=["0", lng_2], Wrap=False)
Z = UnitZ(Factor=multiplication)
nurbs = NurbsCurve(Vertices=disc.Points, Degree=3, Periodic=False)  # -> Curve, Length, Domain
move = Move(Geometry=replace, Motion=Z)  # -> Geometry, Transform
nurbs_2 = NurbsCurve(Vertices=move.Geometry, Degree=3, Periodic=False)  # -> Curve, Length, Domain
loft = Loft(
    Curves=flatten([nurbs.Curve, nurbs_2.Curve]),
    Options={Adjust=False, Closed=False, LoftEnds=0, LoftSimp=0, LoftType=0, Rebuild=10, Refit=0.01})
button = Button()
py3 = Python3Script(ground_anchors=divide.Points, reset=Button(), step_trigger=Toggle(True))  # -> out, Frame, P, C, anc; inputs ground_anchors: list of Point3d, reset: Boolean, step_trigger: Boolean
# ---------- py3: Python ----------
import Rhino.Geometry as rg
import scriptcontext as sc
import random

if 'reset' not in globals(): reset = False
if 'step_trigger' not in globals(): step_trigger = False

class Agent:
    def __init__(self, position):
        self.position = position
        # ۱. خروج اولیه کاملاً رو به بالا (بدون انحراف شدید در XY)
        vx = random.uniform(-0.1, 0.1)
        vy = random.uniform(-0.1, 0.1)
        vz = 1.0 
        self.velocity = rg.Vector3d(vx, vy, vz)
        self.velocity.Unitize()
        self.history = [rg.Point3d(self.position)]

    def get_neighbors(self, all_agents, search_radius):
        neighbors = []
        for other in all_agents:
            if other is not self and self.position.DistanceTo(other.position) <= search_radius:
                neighbors.append(other)
        return neighbors

    def separation(self, neighbors):
        f_sep = rg.Vector3d(0, 0, 0)
        if not neighbors: return f_sep
        for neighbor in neighbors:
            dist = self.position - neighbor.position
            d = dist.Length
            if d > 0:
                dist.Unitize()
                # کنترل شدت دافعه در فاصله‌های بسیار نزدیک (جلوگیری از گره خوردن)
                d_safe = max(d, 0.8)
                dist /= d_safe
                f_sep += dist
        return f_sep 

    def alignment(self, neighbors):
        f_ali = rg.Vector3d(0, 0, 0)
        if not neighbors: return f_ali
        for neighbor in neighbors:
            f_ali += neighbor.velocity
        f_ali /= len(neighbors)
        if f_ali.Length > 0: f_ali.Unitize()
        return f_ali - self.velocity

    def cohesion(self, neighbors):
        if not neighbors: return rg.Vector3d(0, 0, 0)
        sum_vec = rg.Vector3d(0, 0, 0)
        for neighbor in neighbors:
            sum_vec += rg.Vector3d(neighbor.position)
        sum_vec /= len(neighbors)
        desired = rg.Point3d(sum_vec) - self.position
        if desired.Length > 0: desired.Unitize()
        return desired

    def attractor(self, target):
        desired = target - self.position
        if desired.Length > 0: desired.Unitize()
        return desired

    def apply_vector(self, all_agents, search_radius, w_s, w_a, w_c, target_point, w_att):
        neighbors = self.get_neighbors(all_agents, search_radius)
        f_sep = self.separation(neighbors)
        f_ali = self.alignment(neighbors)
        f_coh = self.cohesion(neighbors)

        # کشش به سمت نقطه هدف مشخص در فضا (نه پایه‌ی خودشان)
        f_att = self.attractor(target_point) if target_point else rg.Vector3d(0, 0, 0)

        a_total = (w_s * f_sep) + (w_a * f_ali) + (w_c * f_coh) + (w_att * f_att)
        return a_total

    def update(self, all_agents, search_radius, w_s, w_a, w_c, target_point, w_att, max_speed=1.2):
        a_total = self.apply_vector(all_agents, search_radius, w_s, w_a, w_c, target_point, w_att)
        
        self.velocity += a_total * 0.2
        if self.velocity.Length > 0:
            self.velocity.Unitize()
            self.velocity *= max_speed

        self.position += self.velocity

        if self.position.Z < 0:
            self.position.Z = 0
            self.velocity.Z *= -0.2

        self.history.append(rg.Point3d(self.position))


# نقطه‌ی اوج در مرکز سقف که همه ذرات اول به سمت آن بالا می‌روند
roof_center = rg.Point3d(0, 0, 22)

mem_key = "swarm_clean_pavilion_memory"

if reset or mem_key not in sc.sticky:
    num_agents = 100
    agents = []
    for anchor in ground_anchors:
        for _ in range(num_agents // len(ground_anchors)):
            # تولید منظم نزدیک پایه‌ها
            init_pos = anchor + rg.Vector3d(random.uniform(-0.5, 0.5), random.uniform(-0.5, 0.5), 0.2)
            agents.append(Agent(init_pos))
    sc.sticky[mem_key] = agents
    sc.sticky["frame_step"] = 0

agents = sc.sticky[mem_key]

if step_trigger:
    step = sc.sticky.get("frame_step", 0)
    search_radius = 100.0
    w_s, w_a, w_c = 0.6, 2, 1.5
    
    # در ابتدا جاذبه سقف قوی است تا ذرات مستقیم بالا بروند، سپس کم می‌شود تا طاق شکل بگیرد
    w_att = 1.2 if step < 25 else 0.3
    
    for agent in agents:
        agent.update(agents, search_radius, w_s, w_a, w_c, roof_center, w_att)
    
    sc.sticky["frame_step"] = step + 1

# خروجی هندسی
P = [agent.position for agent in agents]
C = []

for agent in agents:
    pts_count = len(agent.history)
    if pts_count >= 2:
        if pts_count < 4:
            C.append(rg.PolylineCurve(agent.history))
        else:
            crv = rg.Curve.CreateInterpolatedCurve(agent.history, 3)
            if crv: C.append(crv)

a = P
b = C
anc = ground_anchors
# ---------- end py3 ----------
py3_2 = Python3Script(base_surface=loft, initial_curve=divide.Points, reset=Button(), step_trigger=Toggle(True))  # -> out, Frame, a, b, anc; inputs base_surface: list of Surface, initial_curve: Curve, reset: Boolean, step_trigger: Boolean
# ---------- py3_2: Python ----------
import Rhino.Geometry as rg
import scriptcontext as sc
import random

if 'reset' not in globals(): reset = False
if 'step_trigger' not in globals(): step_trigger = False

# ۱. دریافت ایمن ورودی‌ها
def clean_input(val, default_val):
    if val is None:
        return default_val
    return val

base_surface = clean_input(locals().get('base_surface'), None)
init_input = clean_input(locals().get('initial_curve'), None)

# پیش‌فرض در صورت وصل نبودن سطح
if not base_surface:
    base_surface = rg.PlaneSurface(rg.Plane.WorldXY, rg.Interval(-20, 20), rg.Interval(-20, 20))

class SurfaceBoidsAgent:
    def __init__(self, position, velocity):
        self.position = position  
        self.velocity = velocity  
        self.history = [rg.Point3d(position)]

    def get_neighbors(self, all_agents, search_radius):
        neighbors = []
        for other in all_agents:
            if other is not self and self.position.DistanceTo(other.position) <= search_radius:
                neighbors.append(other)
        return neighbors

    def separation(self, neighbors):
        f_sep = rg.Vector3d(0, 0, 0)
        if not neighbors: return f_sep
        for neighbor in neighbors:
            dist = self.position - neighbor.position
            d = dist.Length
            if 0 < d < 2.0:
                dir_v = self.position - neighbor.position
                dir_v.Unitize()
                f_sep += dir_v / d
        return f_sep

    def alignment(self, neighbors):
        f_ali = rg.Vector3d(0, 0, 0)
        if not neighbors: return f_ali
        for neighbor in neighbors:
            f_ali += neighbor.velocity
        f_ali /= len(neighbors)
        if f_ali.Length > 0: f_ali.Unitize()
        return f_ali - self.velocity

    def cohesion(self, neighbors):
        if not neighbors: return rg.Vector3d(0, 0, 0)
        sum_pos = rg.Point3d(0, 0, 0)
        for neighbor in neighbors:
            sum_pos += neighbor.position
        center_mass = rg.Point3d(sum_pos.X / len(neighbors), sum_pos.Y / len(neighbors), sum_pos.Z / len(neighbors))
        desired = center_mass - self.position
        if desired.Length > 0: desired.Unitize()
        return desired

    def path_intersection_avoidance(self, all_agents):
        f_avoid = rg.Vector3d(0, 0, 0)
        look_ahead_dist = 1.5  
        predicted_next_pos = self.position + self.velocity * look_ahead_dist

        for other in all_agents:
            if other is not self and len(other.history) > 1:
                for i in range(len(other.history) - 1):
                    p1 = other.history[i]
                    p2 = other.history[i+1]
                    line = rg.Line(p1, p2)
                    
                    _, t = line.ClosestParameter(predicted_next_pos)
                    closest_pt = line.PointAt(t)
                    dist = predicted_next_pos.DistanceTo(closest_pt)
                    
                    if dist < 0.8:  
                        push_dir = predicted_next_pos - closest_pt
                        if push_dir.Length > 0:
                            push_dir.Unitize()
                            f_avoid += push_dir * (1.0 / max(dist, 0.1))
        return f_avoid

    def update(self, all_agents, surface, search_radius, w_s, w_a, w_c, w_avoid, max_speed=0.6):
        neighbors = self.get_neighbors(all_agents, search_radius)
        
        f_sep = self.separation(neighbors)
        f_ali = self.alignment(neighbors)
        f_coh = self.cohesion(neighbors)
        f_path_avoid = self.path_intersection_avoidance(all_agents)

        a_total = (0.8 * f_sep) + (0.5 * f_ali) + (0.3 * f_coh) + (2.5 * f_path_avoid)

        self.velocity += a_total * 0.1
        if self.velocity.Length > 0:
            self.velocity.Unitize()
            self.velocity *= max_speed

        next_pos = self.position + self.velocity

        rc, u, v = surface.ClosestPoint(next_pos)
        if rc:
            clamped_pt = surface.PointAt(u, v)
            du = surface.Domain(0)
            dv = surface.Domain(1)
            
            if du.Min <= u <= du.Max and dv.Min <= v <= dv.Max:
                self.position = clamped_pt
            else:
                self.velocity *= -1.0
        
        self.history.append(rg.Point3d(self.position))


mem_key = "surface_boids_smart_memory"

# ۲. استخراج هوشمند نقاط اولیه (پشتیبانی از Curve یا Point/List of Points)
if reset or mem_key not in sc.sticky:
    raw_points = []
    
    if init_input:
        items = init_input if isinstance(init_input, list) else [init_input]
        for item in items:
            # اگر ورودی منحنی بود، آن را تقسیم بر نقاط کن
            if isinstance(item, rg.Curve):
                num = min(500, int(item.GetLength() / 0.5))
                if num < 10: num = 50
                params = item.DivideByCount(num, True)
                if params:
                    for t in params:
                        raw_points.append(item.PointAt(t))
            # اگر ورودی نقطه بود، مستقیماً اضافه کن
            elif isinstance(item, rg.Point3d):
                raw_points.append(item)
            elif hasattr(item, "Point"): # حالت هندسی گرس‌هاپر
                raw_points.append(item.Point)

    # اگر چیزی وصل نبود، چند نقطه پیش‌فرض در نظر بگیر
    if not raw_points:
        raw_points = [rg.Point3d(x, 0, 0) for x in range(-10, 10, 2)]

    agents = []
    for pt in raw_points:
        rc, u, v = base_surface.ClosestPoint(pt)
        if rc:
            surface_pt = base_surface.PointAt(u, v)
            vx = random.uniform(-0.1, 0.1)
            vy = random.uniform(-0.1, 0.1)
            vel = rg.Vector3d(vx, vy, 0.1)
            vel.Unitize()
            agents.append(SurfaceBoidsAgent(surface_pt, vel))
                
    sc.sticky[mem_key] = agents
    sc.sticky["frame_step"] = 0

agents = sc.sticky[mem_key]

# ۳. آپدیت گام‌به‌گام
if step_trigger:
    search_radius = 4.0
    w_s, w_a, w_c, w_avoid = 1.0, 1.0, 1.0, 2.0
    
    for agent in agents:
        agent.update(agents, base_surface, search_radius, w_s, w_a, w_c, w_avoid)
    
    sc.sticky["frame_step"] = sc.sticky["frame_step"] + 1

# ۴. خروجی‌ها
P = [agent.position for agent in agents]
C = [rg.PolylineCurve(agent.history) for agent in agents if len(agent.history) >= 2]

a = P  
b = C
# ---------- end py3_2 ----------
panel_5 = Panel(py3.Frame)
panel_6 = Panel(py3_2.Frame)
